# Grasshopper definition hops.gh (Grasshopper 1.0.7)
# plug-ins: Hops

num1 = GetNumber(Slider(0.82, range=-1..1), AtLeast=1, AtMost=1, Maximum=1.797693135e+308, Minimum=-1.797693135e+308, TreeAccess=False)
num2 = GetNumber(Slider(-0.1, range=-1..1), AtLeast=1, AtMost=1, Maximum=1.797693135e+308, Minimum=-1.797693135e+308, TreeAccess=False)
addition = Addition(A=num1, B=num2)
max = Maximum(A=addition, B="0")
min = Minimum(A=max, B="1")
panel = Panel(min)
result = ContextPrint(Text=min)
hops = Hops(
    CacheResultsInMemory=True,
    CacheSolveResults=True,
    RemoteSolveVersion=(0, 1, 0),
    ShowInput_Enabled=False,
    ShowInput_Path=False,
    SynchronousSolve=True)
