# Grasshopper definition skips.gh (Grasshopper 1.0.7)
# plug-ins: LunchBox

run = GetBoolean(AtLeast=1, AtMost=1, FalseValue="False", TrueValue="True")
get_file_path = GetFilePath(AtLeast=1, AtMost=1)
get_integer = GetInteger(AtLeast=1, AtMost=2147483647, Maximum=2147483647, Minimum=-2147483648)
get = GetInteger(AtLeast=1, AtMost=2147483647, Maximum=2147483647, Minimum=-2147483648)
excelread = ExcelReader(ReadExcelData=run, WorkbookPath=get_file_path, WorksheetName="First Layer")  # -> Exceptions, ExcelData
multiplication = Multiplication(A=get_integer, B=get)

# ---- group: RH_OUT:multiplication
num = Number(multiplication)

# ---- group: RH_OUT:data
data = Data(excelread.Exceptions)

# ----
panel = Panel(excelread.Exceptions)
