# Grasshopper definition thermalInsulation.gh (Grasshopper 1.0.7)

curve = GetGeometry(AtLeast=1, AtMost=1, DeleteInput=False, Filter=1074004029)
debrep = DeconstructBrep(Brep=curve)  # -> Faces, Edges, Vertices
len = Length(Curve=debrep.Edges)
sort = SortList(Keys=len, ValuesA=debrep.Edges)  # -> Keys, reverse(ValuesA)
number_slider = Slider(2, range=0..10)
get_number = GetNumber(AtLeast=1, AtMost=1, Maximum=1.797693135e+308, Minimum=-1.797693135e+308)
scale = GetNumber(AtLeast=1, AtMost=1, Maximum=1.797693135e+308, Minimum=-1.797693135e+308)
number_slider_2 = Slider(61, range=0..100)
item = ListItem(List=sort.ValuesA, Index=0, Wrap=True)  # -> Item, Item1
number_slider_3 = Slider(1, range=0..1)
crv = Curve(graft([item.Item, item.Item1]))
num = Number(get_number)
pt = ConstructPoint(XCoordinate=0, YCoordinate=0, ZCoordinate=0)
pt_2 = ConstructPoint(XCoordinate=number_slider_3, YCoordinate=number_slider_3, ZCoordinate=number_slider_3)
neg = Negative(Value=num)
Y = UnitY(Factor=neg)
Y_2 = UnitY(Factor=num)
ln = Line(StartPoint=pt, EndPoint=pt_2)
entwine = Entwine(Branch00=Y_2, Branch01=Y, FlattenInputs=True)  # -> simplify(Result)
flip = FlipCurve(Curve=crv, Guide=ln)  # -> simplify(Curve), Flag
move = Move(Geometry=simplify(flip.Curve), Motion=entwine)  # -> Geometry, Transform
bang = ExplodeTree(Data=move.Geometry)  # -> Branch0, Branch1
divide = DivideCurve(Curve=move.Geometry, Count=scale, Kinks=False)  # -> simplify(Points), Tangents, simplify(Parameters)
bang_2 = ExplodeTree(Data=divide.Points)  # -> Branch0, Branch1
bang_3 = ExplodeTree(Data=divide.Parameters)  # -> Branch0, Branch1
pt_3 = Point(bang_2.Branch0)
pt_4 = Point(bang_2.Branch1)
panel = Panel("""True
False""")
dispatch = Dispatch(List=pt_3, DispatchPattern=panel)  # -> ListA, ListB
panel_2 = Panel("""False
True""")
pt_5 = Point(dispatch.ListA)
shift = ShiftList(List=pt_5, Shift=Slider(1, range=0..1), Wrap=True)
dispatch_2 = Dispatch(List=pt_4, DispatchPattern=panel_2)  # -> ListA, ListB
crv_2 = Curve(bang.Branch1)
shattert = Data(bang_3.Branch0)
shattert_2 = Data(bang_3.Branch1)
dispatch_3 = Dispatch(List=shattert, DispatchPattern=reverse(panel_2))  # -> ListA, ListB
dispatch_4 = Dispatch(List=shattert_2, DispatchPattern=reverse([True, False]))  # -> ListA, ListB
cull_i = CullIndex(List=shift, Indices="-1", Wrap=True)
crv_3 = Curve(bang.Branch0)
ln_2 = Line(StartPoint=cull_i, EndPoint=dispatch_2.ListA)
ln_3 = Line(StartPoint=dispatch.ListA, EndPoint=dispatch_2.ListA)
shatter = Shatter(Curve=crv_2, Parameters=dispatch_4.ListA)
shatter_2 = Shatter(Curve=crv_3, Parameters=dispatch_3.ListA)
merge = Merge(Data1=ln_2, Data2=ln_3)
midpt = CurveMiddle(Curve=shatter)
len_2 = Length(Curve=shatter)
len_3 = Length(Curve=shatter_2)
_2 = Number(2)
division = Division(A=len_2, B=Slider(2, range=0..10))
midpt_2 = CurveMiddle(Curve=shatter_2)
division_2 = Division(A=len_3, B=_2)
crv_4 = Curve(graft(shatter))
circle = CircleCNR(Center=midpt, Normal=Vector(0, 0, 1), Radius=division)
circle_2 = CircleCNR(Center=midpt_2, Normal=Vector(0, 0, 1), Radius=division_2)
crv_5 = Curve(graft(circle))
crv_6 = Curve(graft(shatter_2))
crv_7 = Curve(graft(circle_2))
mcx = MultipleCurves(Curves=[crv_5, crv_4])  # -> Points, IndexA, IndexB, ParamA, ParamB
mcx_2 = MultipleCurves(Curves=[crv_6, crv_7])  # -> Points, IndexA, IndexB, ParamA, ParamB
shatter_3 = Shatter(Curve=crv_7, Parameters=mcx_2.ParamB)
shatter_4 = Shatter(Curve=crv_5, Parameters=mcx.ParamA)
midpt_3 = CurveMiddle(Curve=shatter_4)
midpt_4 = CurveMiddle(Curve=shatter_3)
pdecon = Deconstruct(Point=midpt_3)  # -> XComponent, YComponent, ZComponent
pdecon_2 = Deconstruct(Point=midpt_4)  # -> XComponent, YComponent, ZComponent
sort_2 = SortList(Keys=pdecon.YComponent, ValuesA=shatter_4)  # -> Keys, ValuesA
sort_3 = SortList(Keys=pdecon_2.YComponent, ValuesA=shatter_3)  # -> Keys, ValuesA
item_2 = ListItem(List=sort_2.ValuesA, Index=0, Wrap=True)  # -> Item1, Item
item_3 = ListItem(List=sort_3.ValuesA, Index=0, Wrap=True)  # -> Item1, Item
crv_8 = Curve(flatten(item_2.Item))
crv_9 = Curve(flatten(item_3.Item1))
cull_i_2 = CullIndex(List=crv_8, Indices="0", Wrap=True)
cull_i_3 = CullIndex(List=crv_9, Indices="-1", Wrap=True)
merge_2 = Merge(Data1=flatten(cull_i_3), Data2=flatten(cull_i_2), Data3=flatten(merge), Data4=flatten(crv))

# ---- group: RH_OUT:thermalInsulationHatch
crv_10 = Curve(merge_2)
