# Grasshopper definition waterInsulation.gh (Grasshopper 1.0.7)
# plug-ins: EleFront

number_slider = Slider(1, range=0..1)
division = GetNumber(AtLeast=1, AtMost=1, Maximum=1.797693135e+308, Minimum=-1.797693135e+308)
rectangle = GetGeometry(AtLeast=1, AtMost=1, DeleteInput=False, Filter=1074004029)
debrep = DeconstructBrep(Brep=rectangle)  # -> Faces, Edges, Vertices
pt = ConstructPoint(XCoordinate=0, YCoordinate=0, ZCoordinate=0)
pt_2 = ConstructPoint(XCoordinate=number_slider, YCoordinate=number_slider, ZCoordinate=number_slider)
len = Length(Curve=debrep.Edges)
ln = Line(StartPoint=pt, EndPoint=pt_2)
sort = SortList(Keys=len, ValuesA=debrep.Edges)  # -> Keys, reverse(ValuesA)
item = ListItem(List=sort.ValuesA, Index=0, Wrap=True)  # -> Item, Item1
crv = Curve([item.Item, item.Item1])
flip = FlipCurve(Curve=crv, Guide=ln)  # -> simplify(Curve), Flag
divide = DivideCurve(Curve=flip.Curve, Count=division, Kinks=False)  # -> simplify(Points), Tangents, simplify(Parameters)
bang = ExplodeTree(Data=divide.Points)  # -> Branch0, Branch1
shift = ShiftList(List=bang.Branch1, Shift=Slider(1, range=0..1), Wrap=True)
rec_2pt = Rectangle2Pt(Plane=PlaneXY(0, 0, 0), PointA=bang.Branch0, PointB=shift, Radius=0)  # -> Rectangle, Length
dispatch = Dispatch(List=rec_2pt.Rectangle, DispatchPattern=[True, False])  # -> ListA, ListB
hatch = DefineHatch(Curve=dispatch.ListA, Pattern="Solid", Rotation=0, Scale=1)

# ---- group: RH_OUT:waterInsulationHatchCurve
data = Data(dispatch.ListA)
